# Grasshopper definition triennale3.gh (Grasshopper 1.0.7)

working_curves = Curve([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])  # disabled
crv = Curve([<curve referenced from the Rhino model> x42])
mesh = Mesh(<mesh referenced from the Rhino model>)
mesh_2 = Mesh(<mesh referenced from the Rhino model>)
seq = Sequence(Notation="[N-1] + 16", Length=Slider(80, range=0..1000), Initial=Slider(40, range=0..100))
seq_2 = Sequence(Notation="[N-1] + 16", Length=Slider(80, range=0..1000), Initial=Slider(0, range=0..100))
contour = ContourEx(Shape=mesh, Plane=PlaneXY(0, 0, 0), Offsets=seq)  # -> flatten(Contours)
reb = RebuildCurve(Curve=crv, Degree=Slider(3, range=0..10), Count=Slider(30, range=0..100), Tangents=False)
contour_2 = ContourEx(Shape=mesh_2, Plane=PlaneXY(0, 0, 0), Offsets=seq_2)  # -> flatten(Contours)
recorded_tile_lengths = Panel("""8
10
12
9
8
10
6
5
6
8
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""")
join = JoinCurves(Curves=contour, Preserve=False)
join_2 = JoinCurves(Curves=contour_2, Preserve=False)
crv_2 = Curve(reb)
tile = Slider(1, range=0..2)
mesh_3 = Mesh(<mesh referenced from the Rhino model>)
tile_distribution_with_intersections = GhPythonScript(
    curves=crv_2,
    tile_widths=recorded_tile_lengths,
    mesh=mesh_3,
    tolerance=Slider(1, range=0..2),
    tile_height=tile,
    gap_size=Slider(1, range=0..1))  # -> out, tiles, floor_tiles, all_tile_planes; inputs curves: list of Curve, tile_widths: list, mesh: Mesh
# ---------- tile_distribution_with_intersections: Python ----------
import Rhino.Geometry as rg
import math
import random

# Copy and sort shared inventory
tile_inventory = [float(w) for w in tile_widths]
tiles = []
floor_tiles = [] # too many tiles
all_tile_planes = []  # list of lists: one per curve
tilt_angle_deg = 35 # or set this as a GH input
tilt_angle_rad = math.radians(tilt_angle_deg)

# Sort curves from high to low based on Z of midpoint
def curve_height(c):
    midpoint_param = c.Domain.Mid
    return c.PointAt(midpoint_param).Z

curves.sort(key=curve_height, reverse=True)  # high → low
tile_inventory.sort(reverse=True)  # big tiles first

for crv in curves:
    current_distance = 0.0
    total_length = crv.GetLength()
    curve_planes = []  # center planes for this curve

    while current_distance < total_length - tolerance and tile_inventory:
        fitted = False
        for i, w in enumerate(tile_inventory):
            if current_distance + w <= total_length:
                # Get curve location and tangent
                success_param, param = crv.LengthParameter(current_distance)
                if not success_param:
                    continue
                pt = crv.PointAt(param)
                tangent = crv.TangentAt(param)
                tangent.Unitize()

                # Get mesh normal at closest point
                mesh_point = mesh.ClosestMeshPoint(pt, 10.0)
                if not mesh_point:
                    continue
                normal = mesh.NormalAt(mesh_point)
                normal.Unitize()

                # Flip the hanging direction if it's pointing upward
                z_axis = normal
                z_axis.Unitize()

                # Project the tangent vector into the mesh tangent plane
                t_dot_z = rg.Vector3d.Multiply(tangent, z_axis)
                x_axis = tangent - z_axis * t_dot_z
                if x_axis.IsTiny():
                    x_axis = rg.Vector3d(1, 0, 0)  # fallback if curve is vertical
                x_axis.Unitize()

                # Now build Y axis as orthogonal to both
                y_axis = rg.Vector3d.CrossProduct(z_axis, x_axis)
                y_axis.Unitize()

                # Apply tilt by rotating Y around X (tangent) axis
                # Get slope angle from mesh normal
                slope_angle = rg.Vector3d.VectorAngle(normal, rg.Vector3d(0, 0, 1))
                max_tilt_rad = math.radians(tilt_angle_deg)

                # Reduce tilt based on steepness
                adjusted_tilt = max_tilt_rad * (1.0 - slope_angle / math.pi)
                y_axis.Rotate(adjusted_tilt, x_axis)

                # Offset origin so tile hangs from curve
                current_length= random.uniform(30.0, 40.0)
                origin = pt + y_axis * -current_length + x_axis * -w * 0.5
                tile_plane = rg.Plane(origin, x_axis, y_axis)
                
                # Create the rectangle as a closed polyline (curve)
                rect = rg.Rectangle3d(tile_plane, w - gap_size, current_length)
                rect_polyline = rect.ToPolyline()
                rect_crv = rect_polyline.ToNurbsCurve()

                # Ensure it's closed
                if not rect_crv.IsClosed:
                    continue

                # Create extrusion 
                thickness_vec = tile_plane.ZAxis * tile_height
                shingle_extr = rg.Extrusion.Create(rect_crv, -thickness_vec.Length, True)

                # Convert to Brep
                shingle_brep = shingle_extr.ToBrep()
                tiles.append(shingle_brep)
                                
                center_pt = tile_plane.Origin + x_axis * (w * 0.5) + y_axis * (current_length * 0.5)
                center_plane = rg.Plane(center_pt, x_axis, y_axis)
                curve_planes.append(center_plane)
                
                current_distance += w
                tile_inventory.pop(i)
                fitted = True
                break
        if not fitted:
            break
    all_tile_planes.append(curve_planes)

# Remaining unused tiles → floor layout
x_offset = 0.0
spacing = 2.0  # spacing between floor tiles


for w in tile_inventory:
    floor_plane = rg.Plane(rg.Point3d(x_offset, 0, 0), rg.Vector3d.XAxis, rg.Vector3d.YAxis)
    general_length= 40
    floor_rect = rg.Rectangle3d(floor_plane, w, general_length)
    floor_tiles.append(floor_rect.ToNurbsCurve())
    x_offset += w + spacing
# ---------- end tile_distribution_with_intersections ----------
brep = Brep(tile_distribution_with_intersections.tiles)
panel = Panel(tile_distribution_with_intersections.tiles)
panel_2 = Panel(tile_distribution_with_intersections.all_tile_planes)
